# Grasshopper definition Canopy Maker.gh (Grasshopper 1.0.7)

pt = ConstructPoint(XCoordinate=0, YCoordinate=0, ZCoordinate=0)
column_position = GetPoint(pt, AtLeast=4, AtMost=4, Prompt="Input Four Column Locations", Realtime=True)
column_radius = GetNumber(
    Slider(2, range=0..10),
    AtLeast=1,
    AtMost=4,
    Maximum=1.797693135e+308,
    Minimum=-1.797693135e+308,
    Prompt="Input Column Radii as List")
u_divisions = GetInteger(Slider(6, range=1..40), AtLeast=1, AtMost=1, Maximum=100, Minimum=2, Prompt="U Divisions (2 to 100)")
column_height = GetNumber(
    Slider(10, range=0..10),
    AtLeast=1,
    AtMost=4,
    Maximum=1.797693135e+308,
    Minimum=-1.797693135e+308,
    Prompt="Input Column Heights as List")
v_divisions = GetInteger(Slider(10, range=1..40), AtLeast=1, AtMost=1, Maximum=100, Minimum=2, Prompt="V Divisions (2 to 100)")
canopy_depth = GetNumber(
    Slider(2, range=1..5),
    AtLeast=1,
    AtMost=1,
    Maximum=1.797693135e+308,
    Minimum=-1.797693135e+308,
    Prompt="Input Canopy Depth")
pt_2 = Point([Point(1.557413029, 0.3106360911, 0), Point(2.122171082, 28.89003872, 0), Point(33.18105876, 20.09201982, 0), Point(20.54880642, -5.178773874, 0)])
Z = UnitZ(Factor=column_height)
move = Move(Geometry=column_position, Motion=Z)  # -> graft(Geometry), Transform
cyl = Cylinder(Base=column_position, Radius=column_radius, Length=column_height)
cap = CapHoles(Brep=cyl)
bang = ExplodeTree(Data=move.Geometry)  # -> Branch0, Branch1, Branch2, Branch3
srf4pt = _4PointSurface(CornerA=bang.Branch0, CornerB=bang.Branch1, CornerC=bang.Branch2, CornerD=bang.Branch3)  # -> reparameterize(Surface)
divide = DivideDomain²(Domain=srf4pt, UCount=u_divisions, VCount=v_divisions)
subsrf = Isotrim(Surface=srf4pt, Domain=divide)
debrep = DeconstructBrep(Brep=subsrf)  # -> Faces, Edges, Vertices
flip = FlipMatrix(Data=debrep.Vertices)
bang_2 = ExplodeTree(Data=simplify(flip))  # -> Branch0, Branch1, Branch2, Branch3
ln = Line(StartPoint=bang_2.Branch0, EndPoint=bang_2.Branch2)
ln_2 = Line(StartPoint=bang_2.Branch1, EndPoint=bang_2.Branch3)
join = JoinCurves(Curves=[ln_2, ln], Preserve=False)
cp = ControlPoints(Curve=join)  # -> Points, Weights, Knots
prune = PruneTree(Tree=cp.Points, Minimum="4", Maximum=0)
intcrv = Interpolate(Vertices=prune, Degree=3, Periodic=False, KnotStyle=1)  # -> Curve, Length, Domain
Z_2 = UnitZ(Factor=canopy_depth)
extr = Extrude(Base=intcrv.Curve, Direction=Z_2)
context_bake = ContextBake(Geometry=cap)
context_bake_2 = ContextBake(Geometry=extr)
